# Grasshopper definition test-script-geometry.gh (Grasshopper 1.0.8)

number_slider = Slider(10, range=1..20)
number_slider_2 = Slider(47, range=1..100)
number_slider_3 = Slider(10, range=1..20)
unit_z = UnitZ(Factor=number_slider_2)
rectangle = Rectangle(Plane=PlaneXY(0, 0, 0), XSize=number_slider_3, YSize=number_slider, Radius=0)  # -> Rectangle, Length
extrude = Extrude(Base=rectangle.Rectangle, Direction=unit_z)
multiplication = Multiplication(A=number_slider_3, B="0.5")
multiplication_2 = Multiplication(A=number_slider, B="0.5")
construct_point = ConstructPoint(XCoordinate=multiplication, YCoordinate=multiplication_2, ZCoordinate=0)
construct_point_2 = ConstructPoint(XCoordinate=multiplication, YCoordinate=multiplication_2, ZCoordinate=number_slider_2)
line = Line(StartPoint=construct_point, EndPoint=construct_point_2)
twist = Twist(Geometry=extrude, Axis=line, Angle="pi", Infinite=False, Rigid=False)
