# Grasshopper definition test-script.gh (Grasshopper 1.0.8)

rectangle = Rectangle(Plane=PlaneXY(0, 0, 0), XSize=Domain(-1, 1), YSize=Domain(-2, 2), Radius=0)  # -> Rectangle, Length
area = Area(Geometry=rectangle.Rectangle)  # -> Area, Centroid
concatenate = Concatenate(Fragment_A="IT", Fragment_B="Can", A="work", B=area.Area)
context_print = ContextPrint(Test_output=concatenate)
